# Dynamo graph 04_Copy-Place_CA-Legend.dyn (Dynamo 2.16.2.5624)

# group: Copy "DSP Comp Ref" to Current Project and Place on Sheet > "DSP Comp Ref" Template Location
file_path = Filename("Templates\ACI_Project_Template.rte")

# group: Copy "DSP Comp Ref" to Current Project and Place on Sheet
code_block = CodeBlock { "DSP Comp Ref"; }
code_block_2 = CodeBlock { "FIXTURE PLAN"; }
code_block_3 = CodeBlock { [3.483, 2.695, 0.0]; }
magic = Python(IN[0]=file_path, IN[1]=code_block, IN[2]=code_block_2, IN[3]=code_block_3)  # CPython3
# ---------- magic.python (115 lines) ----------
import clr
clr.AddReference('RevitAPI')
clr.AddReference('RevitServices')
clr.AddReference('System')

from System import Guid
from System.Collections.Generic import List
from Autodesk.Revit.DB import *
from RevitServices.Persistence import DocumentManager
from RevitServices.Transactions import TransactionManager

# Get the current Revit document (the active project)
doc = DocumentManager.Instance.CurrentDBDocument

# Inputs from Dynamo
template_path = IN[0]  # File path to the Revit template (RVT) file
legend_name = IN[1]  # Name of the Legend View to extract
sheet_name = IN[2]   # Name of the sheet to place the legend on
placement_location = IN[3]  # XYZ coordinates for the placement of the legend (tuple/list)

copied_legend_id = None
legend_on_sheet_id = None

try:
    # Check if the legend view already exists in the current project
    existing_legend = next((view for view in FilteredElementCollector(doc).OfClass(View)
                            if view.ViewType == ViewType.Legend and view.Name == legend_name), None)

    if existing_legend:
        copied_legend = existing_legend
    else:
        # Open the Revit template document
        app = doc.Application
        template_doc = app.OpenDocumentFile(template_path)

        try:
            # Find the legend view by name in the template file
            legend_view = next((view for view in FilteredElementCollector(template_doc).OfClass(View)
                                if view.ViewType == ViewType.Legend and view.Name == legend_name), None)

            if legend_view is None:
                OUT = f"Error: Legend view named '{legend_name}' not found in the template."
            else:
                # Start a transaction to copy the legend into the current document
                TransactionManager.Instance.EnsureInTransaction(doc)

                # Copy the legend to the current project
                element_ids = List[ElementId]([legend_view.Id])
                copied_ids = ElementTransformUtils.CopyElements(template_doc, element_ids, doc, Transform.Identity, CopyPasteOptions())

                TransactionManager.Instance.TransactionTaskDone()

                # Get the copied legend
                copied_legend_id = copied_ids[0]
                copied_legend = doc.GetElement(copied_legend_id)
        finally:
            # Ensure the template document is closed
            if not template_doc.IsDisposed:
                template_doc.Close(False)

    # Locate the sheet where the legend should be placed
    sheet = next((s for s in FilteredElementCollector(doc).OfClass(ViewSheet) if s.Name == sheet_name), None)

    if sheet is None:
        OUT = f"Error: Sheet named '{sheet_name}' not found in the current project."
    else:
        # Check if the legend is already on the sheet
        legend_on_sheet = next((doc.GetElement(vp_id) for vp_id in sheet.GetAllViewports()
                                if doc.GetElement(vp_id).ViewId == copied_legend.Id), None)

        # Start a transaction to either place or move the legend on the sheet
        TransactionManager.Instance.EnsureInTransaction(doc)

        # Convert placement_location to XYZ
        x, y, z = placement_location
        position = XYZ(x, y, z)

        try:
            if legend_on_sheet:
                # Move the existing legend to the new position
                legend_on_sheet.SetBoxCenter(position)
                legend_on_sheet_id = legend_on_sheet.Id
                OUT = (f"Legend '{legend_name}' position updated on sheet '{sheet_name}' to ({x}, {y}, {z}).",
                       copied_legend.Id.IntegerValue, legend_on_sheet.Id.IntegerValue)
            else:
                # Place the legend view on the sheet at the specified location
                viewport = Viewport.Create(doc, sheet.Id, copied_legend.Id, position)

                if viewport is None:
                    OUT = f"Error: Could not place the legend '{legend_name}' on sheet '{sheet_name}'."
                else:
                    # Optionally remove any labels from the viewport
                    label_ids = viewport.GetLabelIds()
                    for label_id in label_ids:
                        label = doc.GetElement(label_id)
                        if label:
                            doc.Delete(label.Id)

                    legend_on_sheet_id = viewport.Id
                    OUT = (f"Legend '{legend_name}' successfully placed on sheet '{sheet_name}' at position ({x}, {y}, {z}).",
                           copied_legend.Id.IntegerValue, viewport.Id.IntegerValue)
        except Exception as e:
            TransactionManager.Instance.ForceCloseTransaction()
            OUT = f"Error during placement: {e}"

        TransactionManager.Instance.TransactionTaskDone()

except Exception as e:
    OUT = f"Error: {e}"

# Output the result along with copied legend and viewport IDs if available
if copied_legend_id and legend_on_sheet_id:
    OUT = (OUT, copied_legend_id.IntegerValue, legend_on_sheet_id.IntegerValue)
else:
    OUT = OUT
# ----------------------------------------

watch = Watch(magic)
select_model_element = DSModelElementSelection()  # 1 picked in the model
code_block_4 = CodeBlock { "Title on Sheet"; }
code_block_5 = CodeBlock { "No Label"; }
setParameterByName = Element.SetParameterByName(parameterName=code_block_4, value=code_block_5)  # unwired: element
watch_2 = Watch(setParameterByName)
code_block_6 = CodeBlock { 2; }
getItemAtIndex = List.GetItemAtIndex(list=magic, index=code_block_6)
watch_3 = Watch(getItemAtIndex)
